# Dynamo graph Dynamo_set_generic_model_QR_code_parameters.dyn (Dynamo 2.19.3.6394)

# group: Function Description
# note: Author: Thomas Monaghan
# Date: 21/07/2022
# Updated : 17/03/2025
# Description:
# Fill function for sending QR code binary data streams to GM_QRcode_3D_001 Revit component.
# This function requires a python virtual environnement with the pyQRcode library installed.
# https://pythonhosted.org/PyQRCode/

# note: The input string which will be encoded in the QR Code
building = CustomSelection("C1", items={A1: "A1", A2: "A2", B1: "B1", C1: "C1", C2: "C2"})  # graph input
level = CustomSelection("R03", items={R00: "R00", R01: "R01", R02: "R02", R03: "R03", R04: "R04", R05: "R05", R06: "R06", R07: "R07", R08: "R08", R09: "R09", R10: "R10"})  # graph input
flat = CustomSelection("007", items={001: "001", 002: "002", 003: "003", 004: "004", 005: "005", 006: "006", 007: "007", 008: "008", 009: "009", 010: "010", 011: "011"})  # graph input

# group: Format "Flat" string
string_from_object = FromObject(object=flat)
code_block = CodeBlock { 3; "0"; }
padLeft = String.PadLeft(string=string_from_object, newLength=code_block.out0, padChars=code_block.out1)

room = CustomSelection("Bedroom_03", items={Kitchen: "Kitchen", Entrance: "Entrance", Bathroom: "Bathroom", Toilet: "Toilet", Bedroom_01: "Bedroom_01", Bedroom_02: "Bedroom_02", Bedroom_03: "Bedroom_03", Bedroom_04: "Bedroom_04", Living_Room: "Living_Room"})  # graph input

# group: Concatenate strings
code_block_2 = CodeBlock(a=building, b=level, c=padLeft, d=room) { a+":"+b+":"+c+":"+d; }

# group: Input - Python virtual environnement path string
# note: Path to Python Virtual Environnement with "pyQRcode" package installed
path_string_for_python_virtual = StringInput("E:\TM_2022_12_14\Python\2025_01_24_Python_391_Dynamo_Libraries\venv\Lib\site-packages")  # "Path string for Python Virtual Environnement"

# group: TM Python script
# note: TM Python script to convert text strings to QRcode data and output as an Ascii stream of ones and zeros.
# Uses the python "pyqrcode" module.
# note: Script and component are based on the version 3 of the QRcode (29x29px) and can contain the follwing number of alphanumeric characters based onthe corresponding ECC correction level.
# https://www.qrcode.com/en/about/version.html
# ECC	Alphanumeric
# L	127
# M	101
# Q	77
# H	58
TM_PS_QRcode_as_text_output = Python(IN[0]=code_block_2, IN[1]=path_string_for_python_virtual)  # CPython3
# ---------- TM_PS_QRcode_as_text_output.python (36 lines) ----------
# TM Python script to convert text strings to QRcode data
# and output as an Ascii stream of ones and zeros.
# Uses the python "pyqrcode" module.  
# https://pythonhosted.org/PyQRCode/

# Script and component are based on the version 3 of the 
# QRcode (29x29px) and can contain the follwing number of 
# alphanumeric characters based onthe corresponding ECC 
# correction level.
# https://www.qrcode.com/en/about/version.html
# _______________________________________________________
# ECC	Alphanumeric
# _______________________________________________________
# L	127
# M	101
# Q	77
# H	58


# Import standard libraries
import sys
import clr

# Get input variables.
qrcode_str = IN[0]
venv_path = IN[1]

# Import pyQRcode library from python virtual environnement
sys.path.append(venv_path)
import pyqrcode

# Convert text string to ASCII string
qr = pyqrcode.create(qrcode_str, error='L', version=3)
qr_text=(qr.text())
# Assign your output to the OUT variable.
OUT = qr_text
# ----------------------------------------

# group: Control
watch = Watch(TM_PS_QRcode_as_text_output)

# group: Clean white zone from Ascii output
# note: The python "pyqrcode" module creates a safe white border of 4 characters around the QR code.
# This zone of script removes the 4 lines of zeros on the top and bottom of the ascii output, and the left and right vertical borders.
code_block_3 = CodeBlock { (37*4)+4; }
code_block_4 = CodeBlock { (37*29)+29; }
substring = String.Substring(string=TM_PS_QRcode_as_text_output, startIndex=code_block_3, length=code_block_4)
code_block_5 = CodeBlock { "\n"; }
split = String.Split(string=substring, separator0=code_block_5)
code_block_6 = CodeBlock { 4; 29; }
substring_2 = String.Substring(string=split, startIndex=code_block_6.out0, length=code_block_6.out1)
code_block_7 = CodeBlock { ""; }
join = String.Join(separator=code_block_7, string0=substring_2)

# group: Control
watch_2 = Watch(substring)

# group: Control
watch_3 = Watch(split)

# group: Control
watch_4 = Watch(substring_2)

# group: Control
watch_5 = Watch(join)

# group: Input
# note: Select GM_QR_code component
select_model_element = DSModelElementSelection()  # 1 picked in the model; graph input

# group: Parameter Names
# note: Recuperate Parameter Names
parameters = Element.Parameters(element=select_model_element)
name = Parameter.Name(parameter=parameters)

# group: Filter Parameter List
# note: Filter Parameter Name List to conserve parameters containing "_mat"
code_block_8 = CodeBlock { "_mat"; }
contains = String.Contains(searchFor=code_block_8)  # unwired: string
filter = List.Filter(list=name, condition=contains)

# group: Control
watch_6 = Watch(filter.in)

# group: Convert Ascii string output into list of Boolean values
# note: TM Python script to convert the Ascii string into a list of booleans
TM_PS_Split_string = Python(IN[0]=join)  # IronPython2
# ---------- TM_PS_Split_string.python (22 lines) ----------
# Load the Python Standard and DesignScript Libraries
import sys
import clr
clr.AddReference('ProtoGeometry')
from Autodesk.DesignScript.Geometry import *

# The inputs to this node will be stored as a list in the IN variables.
str = IN[0][0]

# Place your code below this line
str_lst=[]
str_lst[:]=str

bool_lst=[]
for i in str_lst:
	if i == "0":
		bool_lst.append(bool(0))
	if i == "1":
		bool_lst.append(bool(1))

# Assign your output to the OUT variable.
OUT = [bool_lst]
# ----------------------------------------
flatten = List.Flatten(list=TM_PS_Split_string)

# group: Control
watch_7 = Watch(TM_PS_Split_string)

# group: Filter Parameter list
filterByBoolMask = List.FilterByBoolMask(list=filter.in, mask=flatten)

# group: Control
watch_8 = Watch(filterByBoolMask.in)

# group: Control
watch_9 = Watch(flatten)

# group: Apply materials to GM_QRcode_3D_001 sub components
code_block_9 = CodeBlock { "TM_QRcode_black"; "TM_QRcode_white"; }
byName = Material.ByName(name=code_block_9.out1)
# note: Apply "TM_QRcode_white" material to Even Parameter List
setParameterByName = Element.SetParameterByName(element=select_model_element, parameterName=filterByBoolMask.out, value=byName)
byName_2 = Material.ByName(name=code_block_9.out0)
# note: Apply "TM_QRcode_black" material to Odd Parameter List
setParameterByName_2 = Element.SetParameterByName(element=select_model_element, parameterName=filterByBoolMask.in, value=byName_2)

# group: Control
# note: For a version 3 (29x29) pixel Qrcode with borders string length should be 1406
length = String.Length(string=TM_PS_QRcode_as_text_output)

# group: Concatenated String
watch_10 = Watch(code_block_2)  # graph output
